% Requirement links of validate_search_configuration.m (R2026b)

% lines 1-3 implements USV_SAR_Requirements.slreqx#13
function spacing_limit = validate_search_configuration( ...
    detection_range, tracking_error_allowance, max_spacing)
% VALIDATE_SEARCH_CONFIGURATION Check the SEARCH-002 constraint.