% Requirement links of test_contact_loss.m (R2026b)

% line 1 verifies USV_SAR_Requirements.slreqx#15
%% SAR-004 — Contact loss interrupts assistance

% line 125 verifies USV_SAR_Requirements.slreqx#16
%% 10. Check tracking and guidance during contact loss