% Requirement links of test_energy_requirements.m (R2026b)

% lines 18-54 verifies USV_SAR_Requirements.slreqx#9
%% 2. ENE-001: above, at and below the threshold
socCasos = [0.26, 0.25, 0.24];
lowEsperado = [false, true, true];
casosOK = false(size(socCasos));

for k = 1:numel(socCasos)

    pruebaInicial = simIn.setVariable( ...
        'battery_initial_soc', socCasos(k));

    resultadoInicial = sim(pruebaInicial);

    socSignal = resultadoInicial.logsout.getElement('battery_soc');
    lowSignal = resultadoInicial.logsout.getElement('battery_low');

    assert(~isempty(socSignal) && ~isempty(lowSignal), ...
        'Faltan las señales battery_soc o battery_low.');

    socMedido = double(socSignal.Values.Data(1));
    lowMedido = logical(lowSignal.Values.Data(1));

    casosOK(k) = ...
        abs(socMedido - socCasos(k)) < 1e-12 ...
        && lowMedido == lowEsperado(k);

    estado = 'FAIL';
    if casosOK(k)
        estado = 'PASS';
    end

    fprintf( ...
        'ENE-001 | SOC %.2f | esperado %d | obtenido %d | %s\n', ...
        socMedido, lowEsperado(k), lowMedido, estado);
end

assert(all(casosOK), ...
    'ENE-001: algún caso inicial no cumple el criterio.');

% lines 113-147 verifies USV_SAR_Requirements.slreqx#5
%% 4. SAFE-001: return command after low-battery detection
tStatus = status.Values.Time(:);
missionStatus = double(status.Values.Data(:));

iReturn = find(missionStatus == 4, 1, 'first');

assert(~isempty(iReturn), ...
    'SAFE-001 FAIL: no entró en Returning_Home.');

tReturn = tStatus(iReturn);

assert(tReturn >= tAlarm - 1e-8 ...
    && tReturn <= tAlarm + 0.2, ...
    'SAFE-001 FAIL: regreso fuera del intervalo esperado.');

iHome = find(home.Values.Time >= tAlarm + 0.2, 1, 'first');
iReason = find(reason.Values.Time >= tAlarm + 0.2, 1, 'first');

assert(~isempty(iHome) && ~isempty(iReason), ...
    'SAFE-001 FAIL: faltan datos posteriores a la alarma.');

assert(logical(home.Values.Data(iHome)), ...
    'SAFE-001 FAIL: return_home no está activo.');

assert(double(reason.Values.Data(iReason)) == 4, ...
    'SAFE-001 FAIL: motivo de regreso incorrecto.');

fprintf( ...
    'SAFE-001 | alarma %.4f s | regreso %.4f s | PASS\n', ...
    tAlarm, tReturn);

%% 5. Summary
fprintf('\nTodas las comprobaciones de este script han pasado.\n');
fprintf('ENE-001: tres casos iniciales y descarga controlada.\n');
fprintf('SAFE-001: respuesta a batería baja en este escenario.\n');