% Requirement links of test_home_arrival.m (R2026b)

% lines 49-118 verifies USV_SAR_Requirements.slreqx#8: Checks home arrival after a cancellation pulse, completion timing and persistence, and preservation of the return command and reason. Preservation of assistance_completed is not checked in this test.
%% Find the first entry into Home_Reached
iBase = find(estado == 5, 1, 'first');

assert(~isempty(iBase), ...
    'FAIL: no alcanzó Home_Reached durante los 600 s.');

tBase = tEstado(iBase);

assert(any(estado == 4 & tEstado < tBase), ...
    'FAIL: no hay evidencia de regreso antes de llegar a base.');

%% Check position and arrival confirmation at that instant
xBase = interp1(tX, x, tBase, 'linear');
yBase = interp1(tY, y, tBase, 'linear');

arrivedBase = interp1( ...
    tLlegada, arrived, tBase, 'previous');

distanciaBase = hypot(xBase - home_x, yBase - home_y);

assert(isfinite(distanciaBase) ...
    && distanciaBase <= arrival_radius + 1e-6, ...
    'FAIL: Home_Reached se activó fuera del radio de la base.');

assert(arrivedBase == 1, ...
    'FAIL: Home_Reached se activó sin llegada confirmada.');

%% Check mission_completed timing and persistence
assert(completada(1) == 0, ...
    'FAIL: mission_completed comenzó activado.');

assert(all(completada(tFin < tBase - 1e-8) == 0), ...
    'FAIL: mission_completed se activó antes de Home_Reached.');

iFin = find(completada == 1, 1, 'first');

assert(~isempty(iFin), ...
    'FAIL: mission_completed no se activó.');

tCompletada = tFin(iFin);

assert(tCompletada >= tBase - 1e-8 ...
    && tCompletada <= tBase + 0.2, ...
    'FAIL: mission_completed no coincide con la llegada.');

assert(all(completada(iFin:end) == 1), ...
    'FAIL: mission_completed no permaneció activado.');

%% Check that home selection and return reason are preserved
despuesBaseHome = tHome >= tBase;
despuesBaseMotivo = tMotivo >= tBase;

assert(any(despuesBaseHome) && any(despuesBaseMotivo), ...
    'FAIL: faltan datos desde la llegada a base.');

assert(all(returnHome(despuesBaseHome) == 1), ...
    'FAIL: se desactivó la selección de la base.');

assert(all(motivo(despuesBaseMotivo) == 3), ...
    'FAIL: no se conservó el motivo de cancelación manual.');

assert(estado(end) == 5, ...
    'FAIL: el estado final no es Home_Reached.');

%% Report
fprintf('END-001 | llegada %.4f s | distancia %.6f m | PASS\n', ...
    tBase, distanciaBase);

fprintf('mission_completed se activó a %.4f s y permaneció activo.\n', ...
    tCompletada);