% Requirement links of test_manual_cancellation.m (R2026b)

% lines 1-85 verifies USV_SAR_Requirements.slreqx#5: Checks manual cancellation at 10 s with sufficient battery. Partial coverage: cancellation from other mission states and return persistence after command removal are not tested.
%% SAFE-001: manual cancellation with sufficient battery

%% 1. Prepare the simulation
run('init_USV.m');

bloqueCancelacion = ...
    'USV_SAR_GNSS/Operator_Commands/Step';

simIn = create_gnss_test_input;

simIn = simIn.setVariable('battery_initial_soc', 1);
simIn = simIn.setVariable('battery_return_soc', 0.25);

simIn = simIn.setModelParameter( ...
    'StartTime', '0', ...
    'StopTime', '20', ...
    'MaxStep', '0.1', ...
    'SignalLogging', 'on', ...
    'SignalLoggingName', 'logsout');

%% 2. Configure cancellation at 10 seconds
simIn = simIn.setBlockParameter( ...
    bloqueCancelacion, 'Time', '10');

simIn = simIn.setBlockParameter( ...
    bloqueCancelacion, 'InitialValue', '0');

simIn = simIn.setBlockParameter( ...
    bloqueCancelacion, 'FinalValue', '1');

%% 3. Run the simulation
resultadoCancelacion = sim(simIn);

%% 4. Retrieve logged signals
abort = resultadoCancelacion.logsout.getElement('abort_mission');
alarm = resultadoCancelacion.logsout.getElement('battery_low');
status = resultadoCancelacion.logsout.getElement('mission_status');
home = resultadoCancelacion.logsout.getElement('return_home');
reason = resultadoCancelacion.logsout.getElement('return_reason');

assert(~isempty(abort) && ~isempty(alarm) ...
    && ~isempty(status) && ~isempty(home) && ~isempty(reason), ...
    'FAIL: faltan señales registradas.');

%% 5. Check that low battery did not trigger the return
assert(~any(logical(alarm.Values.Data(:))), ...
    'FAIL: se activó batería baja durante la prueba.');

%% 6. Find cancellation and return times
iAbort = find(logical(abort.Values.Data(:)), 1, 'first');
iReturn = find(double(status.Values.Data(:)) == 4, 1, 'first');

assert(~isempty(iAbort) && ~isempty(iReturn), ...
    'FAIL: falta la cancelación o la entrada en regreso.');

tAbort = abort.Values.Time(iAbort);
tReturn = status.Values.Time(iReturn);

%% 7. Check response timing
assert(abs(tAbort - 10) <= 0.1, ...
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