% Requirement links of test_return_persistence.m (R2026b)

% lines 1-93 verifies USV_SAR_Requirements.slreqx#5: Checks that return_home remains active and return_reason remains 3 after a cancellation pulse from 10 to 11 s. Observation continues until 20 s; return or home-reached states are accepted.
%% SAFE-001: return persists after cancellation is removed
% Prepare this test independently.
run('init_USV.m');

pruebaPulso = create_gnss_test_input;

pruebaPulso = pruebaPulso.setVariable('battery_initial_soc', 1);
pruebaPulso = pruebaPulso.setVariable('battery_return_soc', 0.25);

pruebaPulso = pruebaPulso.setModelParameter( ...
    'StartTime', '0', ...
    'StopTime', '20', ...
    'MaxStep', '0.1', ...
    'SignalLogging', 'on', ...
    'SignalLoggingName', 'logsout');

% Activate cancellation at 10 seconds.
bloqueCancelacion = ...
    'USV_SAR_GNSS/Operator_Commands/Step';

pruebaPulso = pruebaPulso.setBlockParameter( ...
    bloqueCancelacion, 'Time', '10');

pruebaPulso = pruebaPulso.setBlockParameter( ...
    bloqueCancelacion, 'InitialValue', '0');

pruebaPulso = pruebaPulso.setBlockParameter( ...
    bloqueCancelacion, 'FinalValue', '1');

bloqueRetirada = ...
    'USV_SAR_GNSS/Operator_Commands/Cancel_Release_Step';

pruebaPulso = pruebaPulso.setBlockParameter( ...
    bloqueRetirada, 'Time', '11');

pruebaPulso = pruebaPulso.setBlockParameter( ...
    bloqueRetirada, 'InitialValue', '0');

pruebaPulso = pruebaPulso.setBlockParameter( ...
    bloqueRetirada, 'FinalValue', '1');

resultadoPulso = sim(pruebaPulso);

% Recuperar señales.
abort = resultadoPulso.logsout.getElement('abort_mission');
alarm = resultadoPulso.logsout.getElement('battery_low');
status = resultadoPulso.logsout.getElement('mission_status');
home = resultadoPulso.logsout.getElement('return_home');
reason = resultadoPulso.logsout.getElement('return_reason');

assert(~isempty(abort) && ~isempty(alarm) ...
    && ~isempty(status) && ~isempty(home) && ~isempty(reason), ...
    'FAIL: faltan señales registradas.');

% Confirmar que el comando fue un pulso.
tAbort = abort.Values.Time(:);
comando = logical(abort.Values.Data(:));

durantePulso = tAbort >= 10.2 & tAbort <= 10.8;
despuesPulso = tAbort >= 11.2;
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